# Grasshopper definition connections.gh (Grasshopper 1.0.7)

panel = Panel("Data set 1")
box = Box([{Plane=PlaneXY(-1, 56, 0), X=Domain(36, 37), Y=Domain(-86, -85), Z=Domain(4.413573584e-11, 1)}, {Plane=PlaneXY(-1, 56, 0), X=Domain(37, 38), Y=Domain(-86, -85), Z=Domain(0, 1)}, {Plane=PlaneXY(-1, 56, 0), X=Domain(37, 38), Y=Domain(-87, -86), Z=Domain(0, 1)}, {Plane=PlaneXY(-1, 56, 0), X=Domain(37, 38), Y=Domain(-87, -86), Z=Domain(1, 2)}, {Plane=PlaneXY(-1, 56, 0), X=Domain(37, 38), Y=Domain(-86, -85), Z=Domain(1, 2)}, {Plane=PlaneXY(-1, 56, 0), X=Domain(36, 37), Y=Domain(-86, -85), Z=Domain(1, 2)}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])

panel_2 = Panel("Data set 2")
box_2 = Box([{Plane=PlaneXY(0, 0, 0), X=Domain(30, 31), Y=Domain(-6, -5), Z=Domain(2, 3)}, {Plane=PlaneXY(0, 0, 0), X=Domain(30, 31), Y=Domain(-7, -6), Z=Domain(2, 3)}, {Plane=PlaneXY(0, 0, 0), X=Domain(30, 31), Y=Domain(-8, -7), Z=Domain(2, 3)}, {Plane=PlaneXY(0, 0, 0), X=Domain(29, 30), Y=Domain(-8, -7), Z=Domain(2, 3)}, {Plane=PlaneXY(0, 0, 0), X=Domain(28, 29), Y=Domain(-8, -7), Z=Domain(2, 3)}, {Plane=PlaneXY(0, 0, 0), X=Domain(30, 31), Y=Domain(-8, -7), Z=Domain(0, 1)}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])

panel_3 = Panel("Data set 3")
box_3 = Box([{Plane=Plane(origin=(22.13419724, 27.77519894, -0.249671936), x=(-1, 0, 0), y=(0, -1, 0)), X=Domain(-0.5, 0.5), Y=Domain(-0.5, 0.5), Z=Domain(-0.5, 0.5)}, {Plane=Plane(origin=(69.13419724, 25.77519894, -1.249671936), x=(-1, 0, 0), y=(0, -1, 0)), X=Domain(-0.5, 0.5), Y=Domain(-0.5, 0.5), Z=Domain(-0.5, 0.5)}, {Plane=Plane(origin=(21.13419724, 27.77519894, 8.750328064), x=(-1, 0, 0), y=(0, -1, 0)), X=Domain(-0.5, 0.5), Y=Domain(-0.5, 0.5), Z=Domain(-0.5, 0.5)}, {Plane=Plane(origin=(71.13419724, 24.77519894, -3.249671936), x=(-1, 0, 0), y=(0, -1, 0)), X=Domain(-0.5, 0.5), Y=Domain(-0.5, 0.5), Z=Domain(-0.5, 0.5)}, {Plane=Plane(origin=(62.13419724, 23.77519894, 1.750328064), x=(-1, 0, 0), y=(0, -1, 0)), X=Domain(-0.5, 0.5), Y=Domain(-0.5, 0.5), Z=Domain(-0.5, 0.5)}, {Plane=Plane(origin=(38.13419724, 27.77519894, 7.750328064), x=(-1, 0, 0), y=(0, -1, 0)), X=Domain(-0.5, 0.5), Y=Domain(-0.5, 0.5), Z=Domain(-0.5, 0.5)}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])

c_script = CSharpScript(boxList=box_2)  # -> out, GROUPS, NOISE; inputs boxList: list of Box
# ---------- c_script: C# ----------
    //convert box to cube
    List<Cube> cubeList = BoxToCube(boxList);

    //find neighbours of each cube
    double tolerance = 0.001;
    if(cubeList.Count > 500)
    {
      int dim = 10;
      List<Point3d> centers = GetCenters(boxList);
      Bounding bounding = GetBounding(centers);
      GetManyRelations(cubeList, bounding, dim, tolerance);
    }
    else GetRelations(cubeList, tolerance);

    //empty list with noise
    List<Box> orphans = new List<Box>();

    //compute groups and noise; add to DataTree
    DataTree<Box> groupTree = GetAllGroups(cubeList, boxList, ref orphans);
    DataTree<Box> noiseTree = NewTree(orphans, 0);

    //output geometry
    GROUPS = groupTree;
    NOISE = noiseTree;
# ---------- c_script: C# additional code ----------
  //CLASS CUBE
  public class Cube
  {
    //class to describe each Box
    public Cube(Point3d center, int id)
    {
      Center = center;
      Neighbours = new List<Cube>();
      Id = id;
      CoordinateX = -1;
      CoordinateY = -1;
      CoordinateZ = -1;
    }
    public Point3d Center; //center of a box
    public List<Cube> Neighbours; //list of connected cubes
    public int Id; //index on boxList

    //coordinates in data structure
    public int CoordinateX;
    public int CoordinateY;
    public int CoordinateZ;
  }


  //CONVERT FUNCTIONS
  public List<Cube> BoxToCube(List<Box> baseList)
  {
    //convert list of boxes to list of cubes
    List<Cube> cubeList = new List<Cube>();
    for (int i = 0; i < baseList.Count; i++)
    {
      Cube element = new Cube(baseList[i].Center, i);
      cubeList.Add(element);
    }
    return cubeList;
  }

  public Box CubeToBox(Cube cube)
  {
    //convert cube to box
    Interval dim = new Interval(-0.5, 0.5);
    Plane a = new Plane(cube.Center, new Vector3d(0, 0, 1));
    return new Box(a, dim, dim, dim);
  }

  public List<Box> CubeToBox(List<Cube>cubes)
  {
    //convert list of cubes to list of boxes
    List<Box> boxes = new List<Box>();
    foreach (var item in cubes)
    {
      boxes.Add(CubeToBox(item));
    }
    return boxes;
  }


  //FIND NEIGHBOURS
  //Condition
  public bool ConnectCheck(Point3d a, Point3d b, double tolerance)
  {
    //check if 2 cubes have connection
    if(a.DistanceTo(b) > 1 - tolerance && a.DistanceTo(b) < 1 + tolerance )
    {
      Vector3d vector = b - a;
      if(Convert.ToBoolean(vector.IsParallelTo(new Vector3d(1, 0, 0)))) return true;
      if(Convert.ToBoolean(vector.IsParallelTo(new Vector3d(0, 1, 0)))) return true;
      if(Convert.ToBoolean(vector.IsParallelTo(new Vector3d(0, 0, 1)))) return true;
    }
    return false;
  }

  //Small number of boxes
  public void GetRelations(List<Cube> cubeList, double tolerance)
  {
    //find neighbours when number of boxes is small
    for (int i = 0; i < cubeList.Count; i++)
    {
      for (int j = 0; j < cubeList.Count; j++)
      {
        if(ConnectCheck(cubeList[i].Center, cubeList[j].Center, tolerance))
        {
          cubeList[i].Neighbours.Add(cubeList[j]);
        }
      }
    }
    return;
  }

  //Large number of boxes
  //Get bounding box
  public List<Point3d> GetCenters(List<Box> boxes)
  {
    //get list of centers of boxes
    List<Point3d> centers = new List<Point3d>();
    foreach (var box in boxes)
    {
      centers.Add(box.Center);
    }
    return centers;
  }

  public struct Bounding
  {
    //bounding values of each coordinate and lengths
    public Bounding(double xMin, double xMax, double yMin, double yMax, double zMin, double zMax)
    {
      XMin = xMin;
      XMax = xMax;
      YMin = yMin;
      YMax = yMax;
      ZMin = zMin;
      ZMax = zMax;
      XRange = Math.Abs(XMax - XMin);
      YRange = Math.Abs(YMax - YMin);
      ZRange = Math.Abs(ZMax - ZMin);
    }
    public double XMin, XMax, YMin, YMax, ZMin, ZMax;
    public double XRange, YRange, ZRange;
  }

  public Bounding GetBounding(List<Point3d>points)
  {
    //compute bounding values and create struct bounding
    double xMin, xMax, yMin,yMax, zMin, zMax;
    double tmpX, tmpY, tmpZ;

    xMin = xMax = points[0].X;
    yMin = yMax = points[0].Y;
    zMin = zMax = points[0].Z;

    for (int i = 1; i < points.Count; i++)
    {
      tmpX = points[i].X;
      tmpY = points[i].Y;
      tmpZ = points[i].Z;
      if(tmpX > xMax) xMax = tmpX;
      if(tmpX < xMin) xMin = tmpX;
      if(tmpY > yMax) yMax = tmpY;
      if(tmpY < yMin) yMin = tmpY;
      if(tmpZ > zMax) zMax = tmpZ;
      if(tmpZ < zMin) zMin = tmpZ;
    }
    Bounding generalBounding = new Bounding(xMin, xMax, yMin, yMax, zMin, zMax);
    return generalBounding;
  }

  //Create 3D array of lists of cubes + add each cube to each specific list
  //possible to check contact only with cubes that are not far away from each other
  public List<Cube>[,,] GetDataStructure (List<Cube> cubeList, Bounding bounding, int dataDim)
  {
    //get 3D array of lists of cubes
    List<Cube>[,,] data = new List<Cube>[dataDim, dataDim, dataDim];

    for (int i = 0; i < (int) dataDim ; i++)
    {
      for (int j = 0; j < (int) dataDim; j++)
      {
        for (int k = 0; k < (int) dataDim; k++)
        {
          data[i, j, k] = new List<Cube>();
        }
      }
    }

    //add cube to each specific list
    foreach (var cube in cubeList)
    {
      //find location in array for each cube
      int xPosition = (int) Math.Floor(Math.Abs(bounding.XMin - cube.Center.X) / (bounding.XRange / dataDim));
      int yPosition = (int) Math.Floor(Math.Abs(bounding.YMin - cube.Center.Y) / (bounding.YRange / dataDim));
      int zPosition = (int) Math.Floor(Math.Abs(bounding.ZMin - cube.Center.Z) / (bounding.ZRange / dataDim));

      //decrease coordinates for bounding valuse
      if(xPosition == dataDim) xPosition--;
      if(yPosition == dataDim) yPosition--;
      if(zPosition == dataDim) zPosition--;

      //save array coordinates
      cube.CoordinateX = xPosition;
      cube.CoordinateY = yPosition;
      cube.CoordinateZ = zPosition;

      data[xPosition, yPosition, zPosition].Add(cube);
    }
    return data;
  }

  public bool IsInData(int x, int y, int z, int dim)
  {
    //check if coordinate is not out of range
    if(x >= 0 & y >= 0 & z >= 0 & x < dim & y < dim & z < dim) return true;
    return false;
  }

  //Find neighbours

  public void FindNeighbours(List<Cube> cubeList, List<Cube>[,,] data, int dataDim, double tolerance)
  {
    //function adds neighbours to each cube
    foreach (var cube in cubeList)
    {
      //check all 27 adjacent clusters
      for (int i = -1; i < 2; i++)
      {
        for (int j = -1; j < 2; j++)
        {
          for (int k = -1; k < 2; k++)
          {
            //check if any array coordinate is out of range
            if(IsInData(cube.CoordinateX + i, cube.CoordinateY + j, cube.CoordinateZ + k, dataDim))
            {
              foreach (var possibleNeighbour in data[cube.CoordinateX + i, cube.CoordinateY + j, cube.CoordinateZ + k])
              {
                if(ConnectCheck(cube.Center, possibleNeighbour.Center, tolerance))
                {
                  cube.Neighbours.Add(possibleNeighbour);
                }
              }
            }
          }
        }
      }
    }
  }


  public void GetManyRelations(List<Cube> cubeList, Bounding bounding, int dataDim, double tolerance)
  {
    //function adds neighbours to each cube
    List<Cube>[,,] data = new List<Cube>[dataDim, dataDim, dataDim];
    data = GetDataStructure(cubeList, bounding, dataDim);

    FindNeighbours(cubeList, data, dataDim, tolerance);

    return;
  }

  //GROUP
  public List<Box> DelOrphans(ref List<Cube> cubeList)
  {
    //delete cubes with 0 neighbours from cubeList and add return new list of them
    List<Box> orphans = new List<Box>();
    int i = 0;
    while(i < cubeList.Count)
    {
      if(cubeList[i].Neighbours.Count == 0)
      {
        orphans.Add(CubeToBox(cubeList[i]));
        cubeList.RemoveAt(i);
        i--;
      }
      i++;
    }
    return orphans;
  }


  public void Group(Cube cube, ref int[] tab, ref List<Box> resultBoxList, List<Box> baseBoxList, ref List<Cube> removeCubeList)
  {
    //recursive function to group cubes
    tab[cube.Id] = 1;
    resultBoxList.Add(baseBoxList[cube.Id]);
    removeCubeList.Remove(cube);
    int i = 0;

    while(i < cube.Neighbours.Count)
    {
      if(tab[cube.Neighbours[i].Id] == 0)
      {
        Group(cube.Neighbours[i], ref tab, ref resultBoxList, baseBoxList, ref removeCubeList);
      }
      i++;
    }
    return;
  }


  public DataTree<Box> GetAllGroups(List<Cube>cubeList, List<Box> baseBoxList, ref List<Box> orphans)
  {
    //find all groups
    List<Cube> removeCubeList = new List<Cube>(cubeList);
    orphans = DelOrphans(ref removeCubeList);

    int i = 0;
    int[] tab = new int[cubeList.Count];
    DataTree<Box> resultTree = new DataTree<Box>();

    while(removeCubeList.Count > 0)
    {
      List<Box> resultBoxList = new List<Box>();
      Group(removeCubeList[0], ref tab, ref resultBoxList, baseBoxList, ref removeCubeList);
      resultTree.AddRange(resultBoxList, new GH_Path(i));
      i++;
    }
    return resultTree;

  }

  //DATA TREE
  public DataTree<Box> NewTree(List<Box>cubes, int path)
  {
    //convert list of cubes to DataTree
    DataTree<Box> myTree = new DataTree<Box>();
    myTree.AddRange(cubes, new GH_Path(path));
    return myTree;
  }
# ---------- end c_script ----------
geo = Geometry(c_script.NOISE)
geo_2 = Geometry(c_script.GROUPS)
